# Dynamo graph VSCode.dyn (Dynamo 2.19.3.6394)

boolean = BoolSelector(false)  # frozen
file_path = Filename(".\SOJ_MTO Length.py")
python_script = Python(IN[0]=boolean, IN[1]=file_path)  # IronPython2
# ---------- python_script.python (5 lines) ----------
re  = open(r"C:\Users\Desktop\Python\02_PyRevit\04_Processing\RevitAPI\01_pyRevitAPI\02_Processing\SOJ_MTO Length.py", "r")

interpret = re.read()

OUT =  interpret
# ----------------------------------------
python_script_from_string = PythonStringNode(script=python_script)  # IronPython2; unwired: IN[0], IN[1]
boolean_2 = BoolSelector(true)
file_path_2 = Filename(".\filterByPipingSystemInActiveView_241228.py")
python_script_2 = Python(IN[0]=boolean_2, IN[1]=file_path_2)  # IronPython2
# ---------- python_script_2.python (5 lines) ----------
re  = open(r"C:\Users\Desktop\Python\02_PyRevit\04_Processing\RevitAPI\01_pyRevitAPI\02_Processing\filterByPipingSystemInActiveView_241228.py", "r")

interpret = re.read()

OUT =  interpret
# ----------------------------------------
code_block = CodeBlock { "PS-XX-OXYGEN"; "PS-XX-OXYGEN+NITROGEN"; }
python_script_from_string_2 = PythonStringNode(script=python_script_2, IN[0]=code_block.out1)  # IronPython2; unwired: IN[1]
boolean_3 = BoolSelector(false)
file_path_3 = Filename(".\setPipeSystem.py")
python_script_3 = Python(IN[0]=boolean_3, IN[1]=file_path_3)  # IronPython2
# ---------- python_script_3.python (5 lines) ----------
re  = open(r"C:\Users\Desktop\Python\02_PyRevit\04_Processing\RevitAPI\01_pyRevitAPI\02_Processing\setPipeSystem.py", "r")

interpret = re.read()

OUT =  interpret
# ----------------------------------------
python_script_from_string_3 = PythonStringNode(script=python_script_3)  # IronPython2; frozen; unwired: IN[0]
boolean_4 = BoolSelector(false)  # frozen
file_path_4 = Filename(".\linkCadToSectionView_v3_241222.py")
python_script_4 = Python(IN[0]=boolean_4, IN[1]=file_path_4)  # IronPython2
# ---------- python_script_4.python (5 lines) ----------
re  = open(r"C:\Users\Desktop\Python\02_PyRevit\04_Processing\RevitAPI\01_pyRevitAPI\02_Processing\linkCadToSectionView_v3_241222.py", "r")

interpret = re.read()

OUT =  interpret
# ----------------------------------------
python_script_from_string_4 = PythonStringNode(script=python_script_4)  # IronPython2; unwired: IN[0]
